# Grasshopper definition choreomusical-blooms.gh (Grasshopper 1.0.7)
# plug-ins: Pufferfish

# ----
# Manipulate the mimetic relationship by representing
# common frequencies in the piece being represented.
# Add more samples for a closer match.
nsamples = Slider(25, range=0..100)
range = Range(Domain=Domain(0, 1), Steps=nsamples)
graph = GraphMapper(
    range,
    x0=0,
    x1=1,
    y0=0,
    y1=1,
    container_name="Sine Summation",
    Equation0_px=[0.1923111677, 0.2507156134],
    Equation0_py=[0.08073621988, 0.3902800083],
    Equation1_px=[0.6, 0.6887490153],
    Equation1_py=[0.3, 0.4136414528])
panel = Panel(graph)

# ----
# Indicate rhythm by changing this polyline graph
# to show how frequency changes. Rhythm
# corresponds to the use of positive / negative space.
nsamples_2 = Slider(16, range=0..100)
range_2 = Range(Domain=Domain(0, 1), Steps=nsamples_2)
graph_2 = GraphMapper(
    range_2,
    x0=0,
    x1=1,
    y0=0,
    y1=1,
    container_name="Polyline",
    pt=[Point(0, 0.6908649206, 0), Point(0.2301379442, 0.4831188917, 0), Point(0.4087996483, 0.6366709471, 0), Point(0.7204191089, 0.3024699092, 0), Point(1, 0.9166764021, 0)])
panel_2 = Panel(graph_2)

# ----
# Manipulate dynamic relationship by adjusting
# interpolated graph to show amplitude / intensity (e.g.
# Bolero might be linear).
range_3 = Range(Domain=Domain(0, 1), Steps=10)
graph_3 = GraphMapper(
    range_3,
    x0=0,
    x1=1,
    y0=0,
    y1=1,
    container_name="Interpolated",
    pt=[Point(0, 0.191280365, 0), Point(0.2177688777, 0.4212884903, 0), Point(0.521073699, 0.1332521439, 0), Point(0.7405555248, 0.7663021088, 0), Point(1, 1, 0)])
panel_3 = Panel(graph_3)

# ----
# Set structural quality by setting text to a pattern
# representative of the phrasing you want to
# demonstrate. E.g. “0, 1, 2, 3, 4, 3, 4, 1, 2, 0”
phrasing = Text("0,1,2, 3, 4, 3, 4, 5, 1, 2, 3, 4, 3")
panel_4 = Panel(phrasing)

unit_cube = Geometry(<brep referenced from the Rhino model>)

# ----
# (Bloom — Step 1.) Generate successive points spaced 137.5 degrees around a cylinder.
spacing = Slider(0.15, range=0..0.15)
# Blooms.
# 
# 
# See https://www.instructables.com/id/Blooming-Zoetrope-Sculptures/ by John Edmark.
height = Slider(108, range=0..500)
radius = Slider(14, range=0..100)
python = GhPythonScript(h=height, s=spacing, r=radius)  # -> out, pts
# ---------- python: Python ----------
"""
Generates successive points spaced 137.5 degrees
around a cylinder. 

Provides a scripting component.
    Inputs:
        h: The height of the cylinder. 
        s: The vertical spacing between points. 
        r: The radius of the cylinder. 
    Output:
        pts: List of points
"""

__author__ = "soniahashim"

import rhinoscriptsyntax as rs
import Rhino.Geometry as geom 

import math 

pts = []


z = 0
idx = 0
a = math.radians(137.5)

while z < h: 
    x = r*math.cos(a*idx)
    y = r*math.sin(a*idx)
    
    p = geom.Point3d(x,y,z)
    pts.append(p)
    
    z = z + s
    idx = idx + 1
    
print("There are {} points".format(idx))
# ---------- end python ----------
pt = Point(python.pts)
panel_5 = Panel(python.out)

# ----
# (Bloom — Step 2.) Project points onto the surface of a sphere.
xy = XYPlane(Origin=Point(0, 0, 0))
height_2 = Slider(54, range=0..100)
radius_2 = Slider(49, range=0..100)
e1 = Vector(Vector(0, 0, 1))
amp = Amplitude(Vector=e1, Amplitude=height_2)
move = Move(Geometry=xy, Motion=amp)  # -> Geometry, Transform
sph = Sphere(Base=move.Geometry, Radius=radius_2)
pull = PullPoint(Point=pt, Geometry=sph, ClosestOnly=True)  # -> ClosestPoint, Distance

# ----
# (Bloom — Step 3.) Connect points with lines to form a mesh.
num = Number(4)
prox = Proximity3D(Points=pull.ClosestPoint, Group=num)  # -> flatten(Links), Topology
python_2 = GhPythonScript(lines=prox.Links, sy=height_2)  # -> out, centers, quads, normals; inputs lines: list of Line
# ---------- python_2: Python ----------
"""Provides a scripting component.
    Inputs:
        lines: The lines between each point and its 4 nearest neighbors
        sy: The y-coordinate of the sphere's centroid sc = (0,sy,0)
    Output:
        centers: A point list of the ordered centers of the quads
        quads: A polyline list of closed quads corresponding to each point
 """

__author__ = "soniahashim"

import rhinoscriptsyntax as rs
import Rhino.Geometry as geom 

# Center of sphere on which points are projected 
sc = geom.Point3d(0, sy, 0)

idx = 0
quads = []
centers = []
normals = []
n_lines = len(lines) 

# Returns +1 if abc ccw, -1 cw, 0 if collinear
def ccw(a, b, c):
    return (b.X - a.X)*(c.Y - a.Y) - (c.X - a.X)*(b.Y - a.Y)

def dist(a,b):
    return (a.X-b.X)*(a.X-b.X) + (a.Y-b.Y)*(a.Y-b.Y)
    
# Iterate through nearest neighbors set of each point 
for idx in range(0, n_lines, 4): 
    # Extract endpoints corresponding to 4 nearest neighbors
    p = lines[idx].From
    p1 = lines[idx].To 
    p2 = lines[idx+1].To
    p3 = lines[idx+2].To
    p4 = lines[idx+3].To
    
    # For now, only create quads (create plane and rectangle)  
    if (p1 != p2 and p1 != p3 and p1 != p4 and p2 != p3 and p2 != p4 and p3 != p4): 
        # Create plane 
        pl = geom.Plane(p1, p2, p3)
        # Create center point 
        c = pl.ClosestPoint(p) 
        
        # Fix order of quads 
        s1 = dist(p1,p2) + dist(p3,p4)
        s2 = dist(p1,p3) + dist(p2,p4)
        s3 = dist(p1,p4) + dist(p2,p3) 
        
        l = []
        if s1 >= s2 and s1 >= s3: 
            l = [p1,p3,p2,p4]
        if s2 >= s1 and s2 >= s3: 
            l = [p1, p2, p3, p4]
        if s3 >= s1 and s3 >= s2: 
            l = [p1, p2, p4, p3] 
        
        q1,q2,q3,q4 = l
        q1 = 0.5*(q1-c)+c
        q2 = 0.5*(q2-c)+c
        q3 = 0.5*(q3-c)+c
        q4 = 0.5*(q4-c)+c
        qq = [q1,q2,q3,q4,q1]
        
        q = geom.Polyline(qq)
        qc = q.CenterPoint()
        
        centers.append(qc)
        quads.append(q)

        # Flip the plane if the normal doesn't point outwards 
        if (geom.Vector3d.VectorAngle(pl.Normal, geom.Vector3d(c.X, c.Y-sy, c.Z)) != 0):
            pl.Flip()
        
        normals.append(pl.Normal)
# ---------- end python_2 ----------
crv = Curve(python_2.quads)
pt_2 = Point(python_2.centers)

c1 = ColourSwatch(SwatchColor=RGB(255, 102, 0))
g1 = Geometry(<brep referenced from the Rhino model>)

leaf_edit = LeafEdit(C=g1, G=g1, c=c1)  # -> G_2, out

geo = Geometry(leaf_edit.G_2)
panel_6 = Panel(leaf_edit.out)

c2 = ColourSwatch(SwatchColor=RGB(247, 60, 2))
g2 = Geometry(<brep referenced from the Rhino model>)

leaf_edit_2 = LeafEdit(C=g2, G=g2, c=c2)  # -> G_2, out

geo_2 = Geometry(leaf_edit_2.G_2)
panel_7 = Panel(leaf_edit_2.out)

c0 = ColourSwatch(SwatchColor=RGB(0, 0, 0))
g9 = Geometry(<brep referenced from the Rhino model>)

leaf_edit_3 = LeafEdit(C=g9, G=g9, c=c0)  # -> G_2, out

geo_3 = Geometry(leaf_edit_3.G_2)
panel_8 = Panel(leaf_edit_3.out)

c3 = ColourSwatch(SwatchColor=RGB(255, 0, 119))
g3 = Geometry(<brep referenced from the Rhino model>)

leaf_edit_4 = LeafEdit(C=g3, G=g3, c=c3)  # -> G_2, out

geo_4 = Geometry(leaf_edit_4.G_2)
panel_9 = Panel(leaf_edit_4.out)

c6 = ColourSwatch(SwatchColor=RGB(17, 0, 255))
g6 = Geometry(<brep referenced from the Rhino model>)

leaf_edit_5 = LeafEdit(C=g6, G=g6, c=c6)  # -> G_2, out

geo_5 = Geometry(leaf_edit_5.G_2)
panel_10 = Panel(leaf_edit_5.out)

c7 = ColourSwatch(SwatchColor=RGB(2, 129, 247))
g7 = Geometry(<brep referenced from the Rhino model>)

leaf_edit_6 = LeafEdit(C=g7, G=g7, c=c7)  # -> G_2, out

geo_6 = Geometry(leaf_edit_6.G_2)
panel_11 = Panel(leaf_edit_6.out)

c0_2 = ColourSwatch(SwatchColor=RGB(255, 187, 0))
# MAT594x Computational Fabrication
# UC Santa Barbara Spring 2020
# 
# Movement in 3D-Printed Forms
# Sketch 1. Choreomuiscal Blooms.
# 
# Sonia Hashim
# Begin here.
# 
# The aim of this project is to create choreomusical
# blooms that explore Hodgins 1992 mappings
# between music and dance to shape form. You may
# listen to the music that is your inspiration for the
# piece as well as the instruments used for a
# performance, dances choreographed to the work, or
# sheet music to help guide your process.
# 
# The geometries you create will be the leaves of your
# bloom. Consider associations, using
# representational / abstracted forms that have
# a narrative element, and indicate an emotional
# response to each through a synaesthetic association
# using color.
# 
# Step. 1. Create up to 10 arbitrary geometric objects
# (meshes, breps, or NURBS surfaces are all ok) and
# attach them to g0, g1, …, g9.
# 
# The number of forms you create indicates a textural
# relationship mapping musical arrangement / number
# of instruments to the momvement corps number of
# performers.
# 
# [Narrative] — Form design.
# 
# [Archetype]  — Associations betweeen forms.
# 
# [Textural] — Number of forms.
# 
# Step. 2. Indicate an emotion attached to each object
# by selecting a color using the color swatch picker
# corresponding to each geometry c0, c1, …, c9.
# 
# [Emotion] — Value & saturation.
# 
# Step 3. Indicate a pattern to use to repeat the forms.
# Note leaves are not placed adjacent to one another.
# The pattern should be indicative of the phrasing
# used in the piece you have in mind. The pattern can
# be an arbitrarly length but should have no white
# spaces and only use the digits 0 through 9.
# 
# [Structural] — Phrasing indicated through pattern.
# 
# Step 4. Indicate a dynamic relationship by adjusting
# the interpolated graph to showcase the intensity of
# the overall piece. Similarly, indicate a mimetic
# relationship (movement mimicking sound) by
# indicating frequencies to create an oscillation in the
# leaves. Lastly, indicate changes in rhythm
# throughout the piece using a polyine graph to affect
# the balance between the spacing of leaves.
# 
# [Dynamic] — Scale factor based on quad area.
# 
# [Mimetic] — Shear in outwards direction.
# 
# [Rhythmic] — Balance positive / negative space.
# 
# If you’d like, select GeoDisplay to view the forms
# that will populate the blooms.
# 
# Note: color is also used for the qualitative
# relationship represented in music as timbre —
# however it’s not yet implemented. Hue would be
# mapped according to tone color by affecting the
# output geometry.
# 
# [Qualitative] — Hue to tone color (not yet
# implemented).
g0 = Geometry(<brep referenced from the Rhino model>)

leaf_edit_7 = LeafEdit(C=g0, G=g0, c=c0_2)  # -> G_2, out

geo_7 = Geometry(leaf_edit_7.G_2)
panel_12 = Panel(leaf_edit_7.out)

c4 = ColourSwatch(SwatchColor=RGB(186, 10, 245))
g4 = Geometry(<brep referenced from the Rhino model>)

leaf_edit_8 = LeafEdit(C=g4, G=g4, c=c4)  # -> G_2, out

geo_8 = Geometry(leaf_edit_8.G_2)
panel_13 = Panel(leaf_edit_8.out)

c5 = ColourSwatch(SwatchColor=RGB(102, 0, 255))
g5 = Geometry(<brep referenced from the Rhino model>)

leaf_edit_9 = LeafEdit(C=g5, G=g5, c=c5)  # -> G_2, out

geo_9 = Geometry(leaf_edit_9.G_2)
panel_14 = Panel(leaf_edit_9.out)

c8 = ColourSwatch(SwatchColor=RGB(255, 255, 255))
g8 = Geometry(<brep referenced from the Rhino model>)

leaf_edit_10 = LeafEdit(C=g8, G=g8, c=c8)  # -> G_2, out

geo_10 = Geometry(leaf_edit_10.G_2)
panel_15 = Panel(leaf_edit_10.out)

# ----
# Process geometry to use in design.
# Select GeomDisplay to view leaves.
geo_11 = Geometry([geo_7, geo, geo_2, geo_4, geo_8, geo_9, geo_5, geo_6, geo_10, geo_3])
bbox = BoundingBox(Content=geo_11, Plane=PlaneXY(0, 0, 0))  # -> Box, Box_2
python_3 = GhPythonScript(geoms=geo_11, boxes=bbox.Box)  # -> out, gdisp, geo; inputs geoms: list of GeometryBase, boxes: list of Box
# ---------- python_3: Python ----------
"""
Centers geometry at origin and uniformly scales 
geometry down to fit within a unit cube.
    Inputs:
        geoms: The geometry inputs
        boxes: The corresponding bounding boxes
    Output:
        gdisp: An evenly spaced out array of scaled geometries
        geo: Collection of geometries all centered at the origin
"""

__author__ = "soniahashim"

import rhinoscriptsyntax as rs
import Rhino.Geometry as geom 

import math

gdisp = []
geo = []
for idx in range(0,len(boxes)): 
    print(geoms[idx])
    print(boxes[idx]) 
    g = geoms[idx]
    b = boxes[idx]
    
    bc = b.Center 
    w = abs(b.X.Length)
    d = abs(b.Y.Length)
    h = abs(b.Z.Length) 
    
    gn = g.Duplicate()
    gn.Translate(geom.Vector3d(-1*bc))
    
    sf = max([w,d,h]) 
    gn.Scale(1/sf) 

    gcopy = gn.Duplicate()
    gcopy.Scale(5)
    gcopy.Translate(geom.Vector3d(idx*10, idx*10, 0))
    gdisp.append(gcopy)
    
    geo.append(gn)
# ---------- end python_3 ----------
geodisplay = Geometry(python_3.gdisp)
geo_12 = Geometry(python_3.geo)

# ----
# (Bloom — Step 6.) Add a base to fit bloom on record player.
outer_radius = Slider(24, range=0..100)
inner_radius = Slider(20, range=0..100)
base_height = Slider(17.5, range=0..25)
xy_2 = XYPlane(Origin=Point(0, 0, 0))
origin = Point(Point(0, 0, 0))
e1_2 = Vector(Vector(0, 0, 1))
cir = Circle(Plane=xy_2, Radius=inner_radius)
cir_2 = Circle(Plane=xy_2, Radius=outer_radius)
line = LineSDL(Start=origin, Direction=e1_2, Length=base_height)
boundary = BoundarySurfaces(Edges=[cir, cir_2])
extrude = ExtrudeLinear(Profile=boundary, OrientationP=PlaneXY(0, 0, 0), Axis=line)

# ----
# (Bloom — Step 5.) Create sphere to bind bloom.
number_slider = Slider(0.953, range=0.9..1.1)
num_2 = Number(0)
pt_3 = ConstructPoint(XCoordinate=num_2, YCoordinate=num_2, ZCoordinate=height_2)
brep = Brep(sph)
scale = Scale(Geometry=brep, Center=pt_3, Factor=number_slider)  # -> Geometry, Transform
true = Boolean(True)
offsrf = OffsetSurface(Surface=scale.Geometry, Distance=Slider(0.5, range=0..5), BothSides=true, CreateSolid=true)

# ----
# (Bloom — Step 4.) Add transformed geometry to each quad.
python_4 = GhPythonScript(
    geos=geo_12,
    pattern=panel_4,
    centers=pt_2,
    quads=crv,
    normals=python_2.normals,
    dynamic=panel_3,
    mimetic=panel,
    rhythm=panel_2,
    sc=pt_3)  # -> out, geode; inputs geos: list of GeometryBase, centers: list of Point3d, quads: list of Polyline, normals: list of Vector3d, dynamic: list, mimetic: list, rhythm: list, sc: Point3d
# ---------- python_4: Python ----------
"""
Attaches geometry by scaling and transforming
to each quad. 

    Inputs:
        centers: The centers of each quad
        quads: The quads 
    Output:
        geodes: The transformed geometries
"""

__author__ = "soniahashim"

import rhinoscriptsyntax as rs
import Rhino.Geometry as geom

import math 

# Set up dynamic relationship to determine quad area scaling
dy_idx = 0
dy_interval = len(quads)/len(dynamic) 
dy_threshold = dy_interval 
dy_sf = .75 + 2*dynamic[dy_idx]

# Set up for frequency based shear 
n_mimetic = len(mimetic) 

# Set up rhythmic relationship for pos / neg space 
rh_idx = 0
rh_interval = len(quads)/len(rhythm) 
rh_threshold = rh_interval
rh_sf = 0.5 + 0.7*rhythm[rh_idx]

# Parse structural pattern to generate phrasing
cycle = map(lambda x: int(x), pattern.split(","))
max_patterns = max(cycle) 
# Fill g to max pattern digit

if max_patterns > len(geos): 
    idx = 0
    while len(geos) <= max_patterns:
        if idx == len(geos): 
            idx = 0
        geos.append(geos[idx]) 
        idx = idx + 1 
mod_length = len(cycle)



geode = []
# Returns area of arbitrary quad 
# Assumes vertices in order: q1, q2, q3, q4
def quadArea(q): 
    q1 = q[0]; q2 = q[1]; q3 = q[2]; q4 = q[3]
    d = geom.Vector3d(q3-q1)
    b1 = geom.Vector3d(q2-q1)
    b2 = geom.Vector3d(q4-q1)
    a1 = geom.Vector3d.VectorAngle(d,b1)
    a2 = geom.Vector3d.VectorAngle(d,b2)
    return 0.5*d.Length*(b1.Length*math.sin(a1) + b2.Length*math.sin(a2))
    

# Transforms from unit cube to quad space 
# Scaled according to size of quad 
def quadSpaceTransform(q, qc, n): 
    q1 = q[0]; q2 = q[1]; q3 = q[2]; q4 = q[3]
    u = (q3-qc).Unitize()
    v = (q4-qc).Unitize()
    w = n.Unitize() 

idx = 0
b = geom.Transform.Identity
s = geom.Transform.Identity
sh = geom.Transform.Identity
for idx in range(0,len(quads)): 
    q = quads[idx] 
    qc = centers[idx]
    n = normals[idx]
    
    q1 = q[0]; q2 = q[1]; q3 = q[2]; q4 = q[3]
    
    if idx > rh_threshold: 
        rh_threshold = rh_threshold + rh_interval
        rh_idx = rh_idx + 1
        rh_sf = 0.5 + 0.7*rhythm[rh_idx] 
        
    su = rh_sf*geom.Vector3d(q3-q1).Length
    sv = rh_sf*geom.Vector3d(q2-q4).Length
    
    if idx > dy_threshold: 
        dy_threshold = dy_threshold + dy_interval 
        dy_idx = dy_idx + 1
        dy_sf = .75 + 2*dynamic[dy_idx]
        
    sw = dy_sf*math.sqrt(quadArea(q))
    u = geom.Vector3d(q3-qc)
    v = geom.Vector3d(q4-qc)
    w = n 
    
    r = qc - sc
    r.Unitize() 
    
    # Check RHR 
    if r*w <= 0:
        w = -n
    u.Unitize(); v.Unitize()
    
    # Transform to new basis 
    b.M00 = u.X
    b.M10 = u.Y
    b.M20 = u.Z
    
    b.M01 = v.X
    b.M11 = v.Y
    b.M21 = v.Z
    
    b.M02 = w.Z
    b.M12 = w.Y
    b.M22 = w.Z 
    
    # Scale according to quad size
    s.M00 = su 
    s.M11 = sv 
    s.M22 = sw
    
    # Shear in w according to frequency
    m_freq = mimetic[idx % n_mimetic]
    sh.M02 = m_freq
    sh.M12 = m_freq
    
    m = idx % mod_length
    g = geos[cycle[m]]
    
    gn = g.Duplicate()
    gn.Transform(b) 
    gn.Transform(s)
    gn.Transform(sh)
    gn.Translate(geom.Vector3d(qc))
    
    geode.append(gn)
# ---------- end python_4 ----------
panel_16 = Panel(python_4.out)
brep_2 = Brep(python_4.geode)

brep_3 = Brep([offsrf, brep_2])

brep_4 = Brep([offsrf, brep_2, extrude])

# ==== cluster LeafEdit
C = ClusterInput()
c = ClusterInput()
bbox = BoundingBox(Content=C, Plane=PlaneXY(0, 0, 0))  # -> Box, Box_2
python = GhPythonScript(b=bbox.Box, c=c)  # -> out, axis, twist_angle, r_base, r_top; inputs g: GeometryBase, b: Box, c: Color
# ---------- python: Python ----------
"""
Processes leaves of blooms before attaching them to 
the final object. Color is mapped to form using 
value to indicate twist (the darker something is the 
more twisted it gets) and saturation is the taper 
(completely bright objects don't taper). 

    Inputs:
        g: The geometric object
        b: The bounding box of the geometric object. 
        c: The color indicating emotion (HSV)
    Output:
        axis: The axis that determines taper / twist 
        twist_angle: The angle in radians to twist
        r_base: The radius at the base of the taper
        r_top: The radius at the top of the taper 
        """

__author__ = "soniahashim"

import rhinoscriptsyntax as rs
import Rhino.Geometry as geom 

import math 


# Convert color to HSV to match swatch picker 
c = rs.ColorRGBToHLS((c.R, c.G, c.B))
hue = c[0]
S = c[1]
L = c[2]
value = L + S*min(L, 1-L) 
sat = 0 
if value != 0: 
    sat = 2*(1 - L/value)
    
print("hue: {}, sat: {}, value: {}".format(hue, sat, value))
    
# Use bounding box to determine transformations 
bc = b.Center 
h = b.Z.Length 

# Axis for twist and taper 
axis_b = geom.Point3d(bc.X, bc.Y, bc.Z - h/2)
axis_e = geom.Point3d(bc.X, bc.Y, bc.Z + h/2) 
axis = geom.Line(axis_b, axis_e)

# Twist amount determined by value
# [0 --> max twist (360 degrees), 1 --> no twist]
twist_angle = math.radians(180*(1-value))

# Taper amount determined by saturation
# [0 --> tapers to a point, 1 --> no taper]  
r_base = min(b.X.Length/2, b.Y.Length/2) 
r_top = r_base*sat
if sat*255 < 1: 
    r_top = 0.01

print("twist {} degrees".format(180*(1-value)))  
print("taper to radius {}".format(r_top))
# ---------- end python ----------
true = Boolean(True)
G = ClusterInput()
out = ClusterOutput(python.out)
twist = Twist(Geometry=G, Axis=python.axis, Angle=python.twist_angle, Infinite=true, Rigid=False)
taper = Taper(Geometry=twist, Axis=python.axis, Start=python.r_base, End=python.r_top, Flat=False, Infinite=False, Rigid=False)
G_2 = ClusterOutput(taper)
