# Grasshopper definition nested-objects.gh (Grasshopper 1.0.7)
# plug-ins: Pufferfish

rad = Slider(9, range=5..21)
mtype = Slider(1, range=0..3)
dist = Slider(3, range=0..10)
rx = Slider(17, range=0..50)
mod = Slider(2, range=0..10)
crv = Curve(<curve referenced from the Rhino model>)
geo = Geometry(<brep referenced from the Rhino model>)
scale = Slider(0.916, range=0..1.25)
nobjects = Slider(7, range=0..10)
offset = Slider(1.694, range=0..12)
p1 = Point(Point(0, 0, 0))
p2 = Point(Point(20, 20, 0))
python = GhPythonScript(rx=rx, p1=p1, p2=p2, mod=mod, mtype=mtype, dist=dist, rad=rad)  # -> out, a, b; inputs rx: Int32, p1: Point3d, p2: Point3d, mod: Int32, mtype: Int32; disabled
# ---------- python: Python ----------
"""Provides a scripting component.
    Inputs:
        p1: The origin point
        p2: The other grid control point
        rx: The interval spacing 
        mod: The value for modulo ops 
        mtype: The type of modulo operand 
        rad: The radius of the form 
    Output:
        a: The a output variable"""

__author__ = "soniahashim"

import rhinoscriptsyntax as rs

''' print hello world''' 
print("hello world") 

''' dist squared func '''
def dist2(a,b):
    return (a.X-b.X)*(a.X-b.X) + (a.Y-b.Y)*(a.Y-b.Y) + (a.Z-b.Z)*(a.Z-b.Z)

''' select mod operand '''
if mtype == 0:
    op = lambda x,y: x*x - y*y
elif mtype == 1: 
    op = lambda x,y: x*x + y*y
elif mtype == 2: 
    op = lambda x,y: x*y
else: 
    op = lambda x,y: x*y+y+1

''' Center of form '''
pcenter = .5*p1+.5*p2

''' Square of radius '''
rad2 = rad*rad

''' create list of points '''
pt = []
dx = (p2.X - p1.X)/(rx-1)
ry = int(0.5+(p2.Y-p1.Y)/dx)
for i in range(0,ry+1):
    for j in range(0,rx):
        x = p1.X + j*dx 
        y = p1.Y + i*dx
        
        if op(i,j)%mod == 0:
            p = rs.CreatePoint(x,y,0.0)
            d = dist2(p, pcenter)
            if d < rad2:
                z = 0.0*d
                pt.append(rs.CreatePoint(x,y,z))
        
a = pt

     
''' create list of lines '''
ln = []
d2 = dist*dist
for j in range(0,len(pt)):
    for i in range(0,len(pt)):
        if i != j and dist2(pt[i],pt[j]) < d2:
            ln.append(rs.AddLine(pt[i],pt[j]))
             
b = ln
# ---------- end python ----------
python_2 = GhPythonScript(c=crv, g=geo, o=offset, s=scale, N=nobjects)  # -> out, a; inputs c: Curve, g: GeometryBase, N: Int32; disabled
# ---------- python_2: Python ----------
"""Provides a scripting component.
    Inputs:
        c: The curve that specifies the transformation 
        g: The base geometry to transform 
        o: The offset for stacking / nesting
        s: The scale factor for iteratively created geometries
        N: The number of objects to create 
    Output:
        a: The a output variable"""

__author__ = "soniahashim"

import rhinoscriptsyntax as rs
import Rhino.Geometry as geom 
import math

'''
method: init_transform
params: i; initial curve that specifies the transformation
-------------------------------------------------------------
Constructs a change of basis using input curve (assumes curve
starts at the origin). Scale factor determined by length of 
curve. Translates geometry to end of curve. 
'''
def init_transform(i):
    p0 = i.PointAtStart
    p1 = i.PointAtEnd
    
    # Calculate inital basis and scale factor 
    t0 = p1-p0; v0 = geom.Vector3d(t0)
    v2 = rs.CreateVector(0,0,1)
    v1 = geom.Vector3d.CrossProduct(v0,v2)
    v2 = geom.Vector3d.CrossProduct(v0,v1)
    scaleFactor = t0.Length/5
    
    # Normalize constructed basis 
    v0.Unitize()
    v1.Unitize()
    v2.Unitize()
    
    # Standard basis 
    e0 = geom.Vector3d.XAxis
    e1 = geom.Vector3d.YAxis
    e2 = geom.Vector3d.ZAxis
    
    # Get change of basis transform (standard --> curve)
    b = geom.Transform.ChangeBasis(e0,e1,e2,v0,v1,-v2)
    
    # Get scale transform matching scale factor set by curve length
    s = geom.Transform.Scale(geom.Point3d.Origin,scaleFactor)
    
    # Get translation transform to curve endpoint 
    r = geom.Transform.Translation(t0)
    
    # Return geometry in new basis, scaled, and translated 
    return b 
    
'''
method: scale
params: x,y,z; scale factors in x,y,z
-------------------------------------------------------------
Returns an affine scale matrix that scales by x, y, z
'''
def scale(x,y,z):
    t = geom.Transform.Identity
    t.M00 = x
    t.M11 = y
    t.M22 = z
    return t; 
 
'''
method: translate
params: x,y,z; translation in x,y,z
-------------------------------------------------------------
Returns an affine translation matrix that translates by x,y,z
'''
def translate(x,y,z):
    t = geom.Transform.Identity
    t.M03 = x
    t.M13 = y
    t.M23 = z
    return t 

'''
method: rotateZ
params: theta; degree in angles 
-------------------------------------------------------------
Returns an affine transformation matrix that rotates around
the z axis by the specified amount 
'''
def rotateZ(theta):
    t = geom.Transform.Identity
    a = math.radians(theta)
    t.M00 = math.cos(a)
    t.M01 = -math.sin(a)
    t.M10 = math.sin(a)
    t.M11 = math.cos(a)
    return t
 
# Set initial transformation of geometry
t = init_transform(c)
g.Transform(t)
f = (c.PointAtEnd - c.PointAtStart).Length/15
t = scale(f,f,f)
g.Transform(t)


h0 = o    # height offset
# s = .85 # iterative scaling 
# N = 5   # number of objects 

w = 0
objects = []
# Create series via iteration to make N objects
for i in range(0,N):
    x = g.Duplicate()
    if i != 0:
        w += (s**(i-1))*(1+s)*h0
        t = scale(s**i, s**i, s**i)
        x.Transform(t)
        t = translate(0, 0, w)
        x.Transform(t)
        t = rotateZ(i*90)
        x.Transform(t)
    objects.append(x)


a = objects
# ---------- end python_2 ----------
panel = Panel(python.out)
dist_2 = Slider(0.128, range=0..1)
panel_2 = Panel(python_2.out)
crv_2 = Curve(python.b)
pt = Point(python.a)
geo_2 = Geometry(python_2.a)
offcrv = OffsetCurve(Curve=crv_2, Distance=dist_2, Plane=PlaneXY(0, 0, 0), BothSides=False, Kinks=0, CapType=1)
boundary = BoundarySurfaces(Edges=offcrv)
extrudeto = Vector(Vector(-0.04080939725, 0, 2.040469862))
extr = Extrude(Base=boundary, Direction=extrudeto)  # -> flatten(Extrusion)
geo_3 = Geometry(extr)
cap = CapHoles(Brep=extr)
sunion = SolidUnion(Breps=cap)
bbox = BoundingBox(Content=sunion, Plane=PlaneXY(0, 0, 0))  # -> Box, Box_2
srfmorph = SurfaceMorph(
    Geometry=sunion,
    Reference=bbox.Box,
    Surface=geo_2,
    UDomain=Slider(0.25, range=0..1),
    VDomain=Slider(0.121, range=0..1),
    WDomain=Slider(0.121, range=0..1))  # disabled
geo_4 = Geometry(srfmorph)
panel_3 = Panel(srfmorph)
