# Grasshopper definition sandbox.gh (Grasshopper 1.0.7)
# plug-ins: Pufferfish

# ----
# (1) Measure lip to set radius.
radius = Slider(42.025, range=40..45)
e2 = Vector(Vector(0, 0, 1))
origin = Point(Point(0, 0, 0))
circle = CircleCNR(Center=origin, Normal=e2, Radius=radius)

# ----
# 1. Create circle on lip
# 2. Create middle circle (adjust radius = pinch, adjust height = pinch height)
# 3. Create upper circle (adjust radius = open, adjust height = height)
# 
# Select angles on middle and top circles to define curves to loft (alternatively perturb in and out by a random amount) (adjust npoints = number of angles to use)
# 
# On upper circle modulate up and down in z (sin(xy))
# 
# Add twist to pinch
crv = Curve(<curve referenced from the Rhino model>)
cp = ControlPoints(Curve=crv)  # -> Points, Weights, Knots
h1_base_height = Slider(3, range=2..10)
h2_hook_height = Slider(7, range=5..10)
w1_inner_lip = Slider(5, range=5..25)
w2_outer_lip = Slider(5, range=5..25)
pt = Point(flatten(cp.Points))
python = GhPythonScript(r=radius, h1=h1_base_height, h2=h2_hook_height, w1=w1_inner_lip, w2=w2_outer_lip, pts=pt)  # -> out, a; inputs pts: list
# ---------- python: Python ----------
"""Provides a scripting component.
    Inputs:
        r:   The outer radius of the object 
        h1:  The height of the lip base 
        h2:  The height of the hook 
        w1:  The inner width of the lip (how far into r)
        w2:  The outer width of the lip (how far out from r)
        pts: The points of the original curve 
    Output:
        a: The a output variable"""

__author__ = "soniahashim"

import rhinoscriptsyntax as rs

p0 = pts[0]; p1 = pts[1]; p2 = pts[2]; 
p3 = pts[3]; p4 = pts[4]; p5 = pts[5]

X = 0; Y = 1; Z = 2


# Set curve radius 
x = -r-2
p0[X] = x 
p4[X] = x
p5[X] = -r

# Use the inner width of the lip 
p1[X] = x + w1
p2[X] = x + w1 

# Use the outer width of the lip 
p3[X] = x - w2

# Use the height of the lip base 
p2[Z] = h1 
p3[Z] = h1

# Use the height of the hook 
y = -h2 
p4[Z] = y


a = [p0,p1,p2,p3,p4,p5,p0]

print(a)
# ---------- end python ----------
_1 = Number(1)
nurbs = NurbsCurve(Vertices=python.a, Degree=_1, Periodic=False)  # -> Curve, Length, Domain
crv_2 = Curve(nurbs.Curve)

hl_leaf_amplitude = Slider(-10, range=-10..10)

t_loft_type = Slider(2, range=0..5)
rb_loft_points = Slider(15, range=10..100)
rp_pinch_radius = Slider(-34, range=-50..50)
ro_open_radius = Slider(-2, range=-50..50)
ho_open_height = Slider(17, range=0..25)
hp_pinch_height = Slider(4, range=0..25)
# (2) Completed Neck
python_2 = GhPythonScript(
    r=radius,
    hb=h1_base_height,
    hp=hp_pinch_height,
    ho=ho_open_height,
    rp=rp_pinch_radius,
    ro=ro_open_radius,
    hl=hl_leaf_amplitude)  # -> out, a, b; inputs hb: Int32, hp: Int32, ho: Int32
# ---------- python_2: Python ----------
"""Provides a scripting component.
    Inputs:
        r: The radius of the base 
        hb: The height of the base
        hp: The height offset of the pinch
        ho: The height offset of the opening
        rp: The radius offset of the pinch
        ro: The radius offset of the opening 
    Output:
        a: The a output variable"""

__author__ = "soniahashim"

import rhinoscriptsyntax as rs
import Rhino.Geometry as geom 
import Rhino.DocObjects.Tables.ObjectTable as rtables
import math 

'''
method: makeCurveWithRadius(r, atHeight, offsetZ, npoints)
params: radius, z-value of curve, offsetZ and number of points 
-------------------------------------------------------------
Makes a curve that approximates a circle parallel to the 
world XY plane with the given radius, height, and number of 
points. 
'''
def makeCurveWithRadius(r, atHeight = 0,  offsetZ = False, npoints = 25):
    theta = 360/(npoints-1)
    pts = []
    for idx in range(npoints):
        a = math.radians(idx*theta)
        x = r*math.cos(a)
        y = r*math.sin(a)
        z = atHeight 
        if offsetZ: 
            z += hl*math.sin(x*y)
        pts.append(geom.Point3d(x,y,z))
    crv = rs.AddInterpCurve(pts, 1)
    rs.CloseCurve(crv)
    return crv


base = makeCurveWithRadius(r, hb-1)
pinch = makeCurveWithRadius(r+rp, hb+hp)
open = makeCurveWithRadius(r+ro, hb+ho, True)
crvs = [base, pinch, open]


a = crvs
b = rs.ScaleObjects(crvs, geom.Point3d(0, 0, hb-1), (.9, .9, .9), True)
# ---------- end python_2 ----------
loft_opt = LoftOptions(Closed=False, Adjust=False, Rebuild=rb_loft_points, Refit=0, Type=t_loft_type)
loft = Loft(Curves=python_2.a, Options=loft_opt)
offsrf = OffsetSurface(Surface=loft, Distance=1, BothSides=False, CreateSolid=True)  # disabled

# ----
# (1) Completed Base
# (1) Adjust lip.
line = Line(Line((0, 0, 0), (0, 0, 10)))
railrev = RailRevolution(Curve=crv_2, Rail=circle, Axis=line, Scale=False)

panel = Panel(python_2.out)
loft_2 = Loft(Curves=python_2.b, Options=loft_opt)
cap = CapHoles(Brep=loft)
cap_2 = CapHoles(Brep=loft_2)
num = Number(1)
mesh = Mesh(offsrf)
join = BrepJoin(Breps=flatten([railrev, offsrf]))  # -> graft(Breps), Closed
sunion = SolidUnion(Breps=flatten(join.Breps))
mesh_2 = MeshBrep(
    Brep=join.Breps,
    Settings={GridMaxCount=0, GridMinCount=16, JaggedSeams=False, MaxEdgeLength=0, MinEdgeLength=0.0001, MinTolerance=0, Refine=True, RefineAngle=0, RelativeTolerance=0.65, SimplePlanes=True, Tolerance=0})
panel_2 = Panel(sunion)
cap_3 = CapHoles()
msh2psrf = MeshToPolysurface(Mesh=mesh, Triangles=False, FaceMerge=False)
msh2psrf_2 = MeshToPolysurface(Mesh=mesh_2, Triangles=False, FaceMerge=False)
