# Grasshopper definition rings.gh (Grasshopper 1.0.7)

apply = Button()
fpath = FilePath("/Users/soniahashim/Documents/Rhinoceros/compfab/week4/test.")
concat = Concatenate(FragmentA=fpath, FragmentB="gcode")
panel = Panel(concat)
outer = Curve()
inner = Curve()
python = GhPythonScript(inner=inner, outer=outer, apply=apply, fname=panel)  # -> out, a; inputs inner: Curve, apply: Boolean
# ---------- python: Python ----------
__author__ = "jenniferjacobs"
__modifiedby__ = "soniahashim"

import rhinoscriptsyntax as rs
import Rhino.Geometry as geom
from datetime import datetime
import math as math


# Hard code temperatures 
BedTemp = 60
NozzleTemp = 205

# Hard code layer height
LayerHeight = .2

def makeGcodeInfo(sb):
    sb.append("; " + datetime.now().strftime("%y%m%d_%H%M%S") + "\n")
    
def makeGcodeHeatSettings(sb):
    sb.append("M140 S" + str(BedTemp) +" ; Set Bed Temperature\n")
    sb.append("M105\n")
    sb.append("M190 S" + str(BedTemp) +" ; Wait for Bed Temperature\n")
    sb.append("M104 S" + str(NozzleTemp) +" ; Set Nozzle Temperature\n")
    sb.append("M105\n")
    sb.append("M109 S" + str(NozzleTemp) +" ; Wait for Nozzle Temperature\n")
    
def makeGcodeStartupSettings(sb):
    sb.append("G28\n")
    sb.append("M83\n")
    sb.append("G90\n")
    sb.append("G1 F300 Z0.4\n")
    sb.append("G1 X50 E8 F800\n")
    

def WriteFile(str, path):
    
    f = open(path, "w")
    f.write(str)
    f.close()

def makeRetraction(amount, speed, sign):
    mes = "";
    if(sign == -1):
        mes = " ; Retraction"
    else:
        mes = " ; Extraction"
    return "G1 F" + str(speed) + " E" + str(sign * amount) + mes + "\n"

def makeGcodeSpeed(fr, to, speed):
    l = (to - fr).Length
    numerator = (_NozzleWidth * l * _LayerHeight)
    denominator = (1.75 / 2) * (1.75 / 2) * math.pi

    e = numerator / denominator

    return "G1 F" + str(speed) + " X" + "{:.{}f}".format(to.X,2) + " Y" + "{:.{}f}".format(to.Y,2) + " E" + "{:.{}f}".format(e,8) + "\n"

def makeGcode(to):
    return "G0 F9000 X" + "{:.{}f}".format(to.X,2) + " Y" + "{:.{}f}".format(to.Y,2) + "\n" 
    


_LayerHeight = LayerHeight;
_NozzleWidth = 0.4;
_RetAmount = 6.0;
_RetSpeed = 1200;
PrintSpeed = 500;
PrintSpeedHigh = 1000;  

# Params
height = 10 # TO DO adjust to 5.0
ncore = 10
tx = 50
ty = 50
r_inner = 10
s = 72
strsb = ''

pts = []
apply = True
if(apply == True):
    # Set up print 
    sb = []
    makeGcodeInfo(sb)
    makeGcodeHeatSettings(sb)
    makeGcodeStartupSettings(sb)
    sb.append(makeRetraction(_RetAmount, _RetSpeed, -1))
    sb.append("G0 X100 Y100\n");
   
    
    # For every height... 
    for k in range(0, height):
        
        # For every ring... 
        for i in range(0,ncore):
            r = r_inner+i
            
            theta = s/r
            npoints = (int)(360/theta)
            # For every point on the ring... 
            for p in range(npoints): 
                a = math.radians(theta)
                x = r*math.cos(p*a)+tx
                y = r*math.sin(p*a)+ty
                
                if p == npoints - 1:
                    xn = r*math.cos(0)+tx
                    yn = r*math.sin(0)+ty
                else: 
                    xn =  xn = r_inner*math.cos((p+1)*a)
                    yn = r_inner*math.sin((p+1)*a)
                p_fr = geom.Point3d(x,y,k)
                p_to = geom.Point3d(xn,yn,k)
                
                pts.append(p_fr)
                # Extrude filament to make up a side of the print
                sb.append(makeGcodeSpeed(p_fr, p_to, PrintSpeed))
                
        # Extrude height after every set of rings except the last
        if k != height-1:
            sb.append("G1 F300 Z" + str(LayerHeight) + "\n")


    sb.append(makeRetraction(_RetAmount, _RetSpeed, -1));
    height += 10;
    sb.append("G1 Z" + "{:.{}f}".format(height*1.0,3) + "\n");

    sb.append("M84");
    strsb = ''.join(sb)
    WriteFile(strsb, fname);  
        

print(strsb)
a = pts
# ---------- end python ----------
pt = Point(python.a)
panel_2 = Panel(python.out)
select_output_directory = FilePath("/Users/soniahashim/Documents/Rhinoceros/compfab/week4/simple.")
file_name = Panel("output.gcode")
concat_2 = Concatenate(FragmentA=select_output_directory, FragmentB=file_name)
output_file_path = Panel(concat_2)
